# Grasshopper definition extractLine.gh (Grasshopper 1.0.8)
# plug-ins: atit, MetaCityGenerator, Geospatial

panel = Panel("C:\D\Code\114_temp\008_CodeCollection\001_python\038_scientificData\data\debug\input")
panel_2 = Panel("C:\D\Code\114_temp\008_CodeCollection\001_python\038_scientificData\data\debug\input")
number_slider = Slider(39, range=0..39)
python_3_script = Python3Script(x=panel, y=panel_2)  # -> out, a, b, c
# ---------- python_3_script: Python ----------
import os

in_put=x
out_put=y
res=[]
names=[]
dirs=[]


for file in os.listdir(in_put):
    file_dir = os.path.join(in_put,file)
    print(file)
    if os.path.isdir(file_dir):
        file2_dir=os.path.join(file_dir,"selected_roads_32650")
        file2_path=os.path.join(file2_dir, "selected_roads_32650.shp")
        res.append(file2_path)
        name='roads_centroidline.geojson'
        names.append(name)
        dirs.append(file_dir)


a=res
b=names
c=dirs
# ---------- end python_3_script ----------
list_item = ListItem(List=python_3_script.a, Index=number_slider, Wrap=True)
list_item_2 = ListItem(List=python_3_script.b, Index=number_slider, Wrap=True)
list_item_3 = ListItem(List=python_3_script.c, Index=number_slider, Wrap=True)
boolean_toggle = BooleanToggle(True)
imp_it = ImpIt(ShapefileShpPath=list_item, Project2WGS84=False, TrueOrFalse=boolean_toggle)  # -> Shapes, Features
datavis_it = DataVisIt(Shapes=imp_it.Shapes, GetValueofFeature=imp_it.Features, TrueOrFalse=boolean_toggle)  # -> Polygon, Polyline, Point, AttValues
curve = Curve(flatten(datavis_it.Polyline))
centerlineextraction = CenterLineExtraction(InputCurve=curve, GridSize=500, BufferDist=10, InterpolateDist=10, Epsilon=10, SegmentThreshold=10)

curve_2 = Curve(flatten(centerlineextraction))
explode = Explode(Curve=curve_2, Recursive=True)  # -> Segments, Vertices
end_points = EndPoints(Curve=explode.Segments)  # -> Start, End
line = Line(StartPoint=end_points.Start, EndPoint=end_points.End)  # -> flatten(Line)
clean_tree = CleanTree(RemoveNulls=True, RemoveInvalid=True, RemoveEmpty=False, Tree=line)

feature_from_lines = FeatureFromLines(Curves=graft(clean_tree))
panel_3 = Panel(list_item_3)
join_geojson = JoinGeoJSON(Features=flatten(feature_from_lines))
panel_4 = Panel(list_item_2)
boolean_toggle_2 = BooleanToggle(True)
write_file = WriteFile(Directory=panel_3, Filename=panel_4, Data=join_geojson, Run=boolean_toggle_2, Overwrite=boolean_toggle_2)
